# Grasshopper definition Pebble Fit-modify.gh (Grasshopper 1.0.7)
# plug-ins: MeshEdit Components, Kangaroo Components, PlanktonGh, Bifocals, Weaverbird

unit_z = UnitZ(Factor=Slider(0.3, range=0..1))
xy_plane = XYPlane(Origin=Point(0, 0, 0))
negative = Negative(Value=unit_z)
move = Move(Geometry=xy_plane, Motion=negative)  # -> Geometry, Transform
multiplication = Multiplication(A=Slider(2, range=0..10), B=negative)
xy_plane_2 = XYPlane(Origin=Point(0, 0, 0))
xy_plane_3 = XYPlane(Origin=multiplication)

number_slider = Slider(100, range=0..100)
rectangle = Rectangle(Plane=PlaneXY(0, 0, 0), XSize=number_slider, YSize=number_slider, Radius=0)  # -> Rectangle, Length
populate_2d = Populate2D(Region=rectangle.Rectangle, Count=Slider(200, range=0..1000), Seed=1)

unit_x = UnitX(Factor=1)
area = Area(Geometry=rectangle.Rectangle)  # -> Area, Centroid
division = Division(A=number_slider, B=2)
line_sdl = LineSDL(Start=area.Centroid, Direction=unit_x, Length=division)
divide_curve = DivideCurve(Curve=reparameterize(line_sdl), Count=Slider(100, range=0..100), Kinks=False)  # -> Points, Tangents, Parameters
pi = Pi(Factor=Slider(4, range=0..10))
multiplication_2 = Multiplication(A=divide_curve.Parameters, B=pi)
rotate = Rotate(Geometry=divide_curve.Points, Angle=multiplication_2, Plane=area.Centroid)  # -> Geometry, Transform
interpolate = Interpolate(Vertices=rotate.Geometry, Degree=3, Periodic=False, KnotStyle=1)  # -> Curve, Length, Domain

curve_closest_point = CurveClosestPoint(Point=populate_2d, Curve=reparameterize(interpolate.Curve))  # -> Point, Parameter, Distance
sort_list = SortList(Keys=curve_closest_point.Parameter, ValuesValuesA=populate_2d)  # -> Keys, ValuesValuesA
voronoi = Voronoi(Points=sort_list.ValuesValuesA, Boundary=rectangle.Rectangle, BruteForceOverride=False)  # -> simplify(Cells)
partition_list = PartitionList(List=voronoi, Size=Slider(2, range=0..10))  # -> simplify(Chunks)
area_2 = Area(Geometry=partition_list)  # -> Area, Centroid

# ---- group: 生成三角网络的关键
extrude_point = ExtrudePoint(Base=partition_list, Point=area_2.Centroid)

# ----
number_slider_2 = Slider(2, range=0..10)
brep_join = BrepJoin(Breps=extrude_point)  # -> Breps, Closed
simple_mesh = SimpleMesh(Brep=brep_join.Breps)
weld_mesh = WeldMesh(Mesh=simple_mesh, Angle=3.141592654)  # -> flatten(Result)
area_3 = Area(Geometry=weld_mesh)  # -> Area, Centroid
scale = Scale(Geometry=weld_mesh, Center=area_3.Centroid, Factor=Slider(1.2, range=0..10))  # -> Geometry, Transform
weaverbird_s_catmull_clark_subdivision = WeaverbirdsCatmullClarkSubdivision(MeshCurves=scale.Geometry, Level=number_slider_2, SmoothNakedEdges=1)  # -> simplify(OutputMeshCurves)
mesh_edges = MeshEdges(Mesh=weaverbird_s_catmull_clark_subdivision)  # -> NakedEdges, InteriorEdges, NonManifoldEdges
join_curves = JoinCurves(Curves=mesh_edges.NakedEdges, Preserve=False)  # -> simplify(Curves)
control_points = ControlPoints(Curve=join_curves)  # -> Points, Weights, Knots
removeduplicatepts = RemoveDuplicatePts(Points=control_points.Points, Tolerance=0.01)  # -> simplify(UniquePoints)
sequence = Sequence(Frames=2)
meshmachine = MeshMachine(
    Geometry=weaverbird_s_catmull_clark_subdivision,
    Length=Slider(1, range=0..2),
    FixCurves=join_curves,
    FixVertices=removeduplicatepts,
    Flip=1,
    PullStrength=0.8,
    CurvatureAdaptivity=0,
    BoundaryScale=1,
    BoundaryDistance=5,
    Exponent=2,
    Background=0.5,
    Iterations=Slider(2, range=0..10),
    Reset=sequence)
list_item = ListItem(List=reverse(meshmachine), Index=0, Wrap=True)
planktonmesh = PlanktonMesh(list_item)
mesh = Mesh(planktonmesh)

deconstruct_mesh = DeconstructMesh(Mesh=mesh)  # -> simplify(Vertices), Faces, Colours, Normals
curve_closest_point_2 = CurveClosestPoint(Point=deconstruct_mesh.Vertices, Curve=join_curves)  # -> Point, Parameter, Distance
bounds = Bounds(Numbers=curve_closest_point_2.Distance)
remap_numbers = RemapNumbers(Value=curve_closest_point_2.Distance, Source=bounds, Target=Domain(0, 1))  # -> Mapped, Clipped
graph_mapper = GraphMapper(
    remap_numbers.Mapped,
    x0=0,
    x1=1,
    y0=0,
    y1=1,
    container_name="Bezier",
    cpx=[0, 0.004988960456, 0.5573907495, 1],
    cpy=[0, 0.9730587006, 1, 1])
remap_numbers_2 = RemapNumbers(Value=graph_mapper, Source=Domain(0, 1), Target=Slider(4.7, range=0..10))  # -> Mapped, Clipped
unit_z_2 = UnitZ(Factor=remap_numbers_2.Mapped)
move_2 = Move(Geometry=deconstruct_mesh.Vertices, Motion=unit_z_2)  # -> Geometry, Transform

# ---- group: stone texuture with wide gap
number_slider_3 = Slider(5, range=0..10)  # disabled
unit_z_3 = UnitZ(Factor=number_slider_3)  # disabled
extrude = Extrude(Base=brep_join.Breps, Direction=unit_z_3)  # disabled
simple_mesh_2 = SimpleMesh(Brep=extrude)  # disabled
weaverbird_s_catmull_clark_subdivision_2 = WeaverbirdsCatmullClarkSubdivision(MeshCurves=simple_mesh_2, Level=number_slider_2, SmoothNakedEdges=1)  # disabled

# ----
number_slider_4 = Slider(0.84, range=0..1)
construct_mesh = ConstructMesh(Vertices=move_2.Geometry, Faces=deconstruct_mesh.Faces)
mesh_edges_2 = MeshEdges(Mesh=construct_mesh)  # -> NakedEdges, InteriorEdges, NonManifoldEdges
join_curves_2 = JoinCurves(Curves=mesh_edges_2.NakedEdges, Preserve=False)
sequence_2 = Sequence(Frames=2)
meshmachine_2 = MeshMachine(
    Geometry=construct_mesh,
    Length=Slider(0.5, range=0..2),
    FixCurves=join_curves_2,
    Flip=1,
    PullStrength=0.8,
    CurvatureAdaptivity=0,
    BoundaryScale=1,
    BoundaryDistance=5,
    Exponent=2,
    Background=0.5,
    Iterations=Slider(10, range=0..10),
    Reset=sequence_2)
list_item_2 = ListItem(List=reverse(meshmachine_2), Index=0, Wrap=True)
planktonmesh_2 = PlanktonMesh(list_item_2)
mesh_2 = Mesh(simplify(planktonmesh_2))

mesh_edges_3 = MeshEdges(Mesh=mesh_2)  # -> NakedEdges, InteriorEdges, NonManifoldEdges
mirror = Mirror(Geometry=mesh_2, Plane=move.Geometry)  # -> Geometry, Transform
join_curves_3 = JoinCurves(Curves=mesh_edges_3.NakedEdges, Preserve=False)  # -> simplify(Curves)
mesh_edges_4 = MeshEdges(Mesh=mirror.Geometry)  # -> NakedEdges, InteriorEdges, NonManifoldEdges
join_curves_4 = JoinCurves(Curves=join_curves_3, Preserve=False)  # -> simplify(Curves)
join_curves_5 = JoinCurves(Curves=mesh_edges_4.NakedEdges, Preserve=False)  # -> simplify(Curves)
weaverbird_s_join_meshes_and_weld = WeaverbirdsJoinMeshesAndWeld(Mesh=flatten(mesh_2), Weld=False)
mirror_2 = Mirror(Geometry=weaverbird_s_join_meshes_and_weld, Plane=move.Geometry)  # -> simplify(Geometry), Transform
region_union = RegionUnion(Curves=flatten(join_curves_5), Plane=xy_plane_3)
region_union_2 = RegionUnion(Curves=flatten(join_curves_4), Plane=xy_plane_2)
list_item_3 = ListItem(List=region_union_2, Index=0, Wrap=True)
list_item_4 = ListItem(List=region_union, Index=0, Wrap=True)
explode = Explode(Curve=list_item_4, Recursive=True)  # -> graft(Segments), Vertices
explode_2 = Explode(Curve=list_item_3, Recursive=True)  # -> graft(Segments), Vertices
loft = Loft(
    Curves=[explode_2.Segments, explode.Segments],
    Options={Adjust=False, Closed=False, LoftEnds=0, LoftSimp=0, LoftType=0, Rebuild=10, Refit=0.01})
triangulate = Triangulate(Mesh=loft)  # -> simplify(Mesh), Count
weaverbird_s_join_meshes_and_weld_2 = WeaverbirdsJoinMeshesAndWeld(Mesh=flatten(triangulate.Mesh), Weld=False)
mesh_flip = MeshFlip(Mesh=weaverbird_s_join_meshes_and_weld_2)
weaverbird_s_join_meshes_and_weld_3 = WeaverbirdsJoinMeshesAndWeld(Mesh=flatten([weaverbird_s_join_meshes_and_weld, mirror_2.Geometry, mesh_flip]), Weld=False)
weld_mesh_2 = WeldMesh(Mesh=weaverbird_s_join_meshes_and_weld_3, Angle=3.141592654)
weaverbird_s_catmull_clark_subdivision_3 = WeaverbirdsCatmullClarkSubdivision(MeshCurves=weld_mesh_2, Level=Slider(2, range=0..10), SmoothNakedEdges=1)  # -> simplify(OutputMeshCurves)
smooth_mesh = SmoothMesh(Mesh=weaverbird_s_catmull_clark_subdivision_3, Strength=0.5, SkipNaked=True, Iterations=1)
custom_preview = CustomPreview(
    Geometry=smooth_mesh,
    Shader={diffuse=RGB(255, 105, 180), emission=RGB(76, 32, 54), shine=0.5, specular=RGB(255, 255, 255), transparency=0})  # disabled
